# Grasshopper definition Mesh Site Alititude Analysis.gh (Grasshopper 1.0.5)

mesh = Mesh(<mesh referenced from the Rhino model>)
deconstruct_mesh = DeconstructMesh(Mesh=mesh)  # -> Vertices, Faces, Colours, Normals
# Mesh Site Altitude Analysis
deconstruct = Deconstruct(Point=deconstruct_mesh.Vertices)  # -> XComponent, YComponent, ZComponent
# Legend Generation
colour_swatch = ColourSwatch(SwatchColor=RGB(227, 214, 191))
merge = Merge(
    Data1=colour_swatch,
    Data2=ColourSwatch(SwatchColor=RGB(222, 192, 140)),
    Data3=ColourSwatch(SwatchColor=RGB(90, 115, 100)),
    Data4=ColourSwatch(SwatchColor=RGB(67, 92, 91)),
    Data5=ColourSwatch(SwatchColor=RGB(70, 96, 110)))
sort_list = SortList(Keys=deconstruct.ZComponent)  # -> Keys, ValuesA
rectangle = Rectangle({Plane=Plane(origin=(-3702624.488, -4180427.08, 11061.97142), x=(0.9999993343, -1.118056876e-06, 0.001153869813), y=(-3.105720052e-07, 0.9999992335, 0.001238118722)), Size=Domain2(u=-52712.5408..52712.5408, v=-229576.5239..229576.5239)})
reverse_list = ReverseList(List=merge)
list_item = ListItem(List=reverse(sort_list.Keys), Index=0, Wrap=True)
list_item_2 = ListItem(List=sort_list.Keys, Index=0, Wrap=True)
legend = Legend(Colour=reverse_list, Rectangle=rectangle, LegendType=101)
gradient = Gradient(
    LowerLimit=list_item_2,
    UpperLimit=list_item,
    Parameter=deconstruct.ZComponent,
    stops=[0: RGB(227, 216, 195), 0.25: RGB(222, 191, 138), 0.5: RGB(88, 115, 100), 0.75: RGB(67, 92, 91), 1: RGB(71, 98, 112)])
mesh_colours = MeshColours(Mesh=mesh, Colours=gradient)
