# Grasshopper definition Mesh Site Aspect Analysis.gh (Grasshopper 1.0.5)

mesh = Mesh(<mesh referenced from the Rhino model>)
deconstruct_mesh = DeconstructMesh(Mesh=mesh)  # -> Vertices, Faces, Colours, Normals
vector = Vector(deconstruct_mesh.Normals)
project = Project(Geometry=vector, Plane=PlaneXY(0, 0, 0))  # -> Geometry, Transform
unit_y = UnitY(Factor=1)
xy_plane = XYPlane(Origin=Point(0, 0, 0))
angle = Angle(VectorA=project.Geometry, VectorB=unit_y, Plane=xy_plane)  # -> Angle, Reflex
degrees = Degrees(Radians=angle.Angle)
# Mesh Site Aspect Analysis
sort_list = SortList(Keys=degrees)  # -> Keys, ValuesA
reverse_list = ReverseList(List=sort_list.Keys)
list_item = ListItem(List=sort_list.Keys, Index=0, Wrap=True)
list_item_2 = ListItem(List=reverse_list, Index=0, Wrap=True)
gradient = Gradient(
    LowerLimit=list_item,
    UpperLimit=list_item_2,
    Parameter=degrees,
    stops=[0: RGB(58, 80, 92), 0.249: RGB(77, 102, 95), 0.501: RGB(227, 214, 191), 0.75: RGB(219, 189, 136), 1: RGB(58, 81, 92)])
mesh_colours = MeshColours(Mesh=mesh, Colours=gradient)
