# Grasshopper definition Mesh Site Gradient Analysis.gh (Grasshopper 1.0.5)

# Mesh Site Gradient Analysis/Suitable Constructable Land
mesh = Mesh(<mesh referenced from the Rhino model>)
demesh = DeconstructMesh(Mesh=mesh)  # -> Vertices, Faces, Colours, Normals
unit = UnitVector(Vector=demesh.Normals)
Z = UnitZ(Factor=1)
angle = Angle(VectorA=unit, VectorB=Z)  # -> Angle, Reflex
deg = Degrees(Radians=angle.Angle)
tan = Tangent(Value=degrees(deg))

# ----
# Restriction
panel = Panel("0.15")

middlelimit = Number("0.25")
lowerlimit = Number(panel)
upperlimit = Number("0.40")
lng = ListLength(List=tan)
expression = Expression(x=tan, y=lowerlimit, z=middlelimit, u=upperlimit, Expression="if(x≤u,if(x≤z,If(x≤y,0,1),2),3)")
dup = DuplicateData(Data=ColourSwatch(SwatchColor=RGB(250, 193, 5)), Number=lng, Order=True)
dup_2 = DuplicateData(Data=ColourSwatch(SwatchColor=RGB(232, 31, 21)), Number=lng, Order=True)
dup_3 = DuplicateData(Data=ColourSwatch(SwatchColor=RGB(0, 99, 46)), Number=lng, Order=True)
dup_4 = DuplicateData(Data=ColourSwatch(SwatchColor=RGB(168, 199, 12)), Number=lng, Order=True)
p_n_c = PickNChoose(Pattern=expression, Stream0=dup_3, Stream1=dup_4, Stream2=dup, Stream3=dup_2)
mcol = MeshColours(Mesh=mesh, Colours=p_n_c)
