# Grasshopper definition Mesh Site Model Generation.gh (Grasshopper 1.0.5)

curve = Curve()
length = Length(Curve=curve)
division = Division(A=length, B=Slider(60, range=0..100))
integer = Integer(division)
divide_curve = DivideCurve(Curve=curve, Count=integer, Kinks=False)  # -> flatten(Points), Tangents, Parameters
cull_duplicates = CullDuplicates(Points=divide_curve.Points, Tolerance=0.1, CullMode=3)  # -> Points, Indices, Valence
delaunay_mesh = DelaunayMesh(Points=cull_duplicates.Points, Plane=PlaneXY(0, 0, 0))
