# Grasshopper definition Mesh Site Runoff Analysis.gh (Grasshopper 1.0.5)
# plug-ins: Section To XY

# Mesh Site Runoff Analysis
crv = Curve(<curve referenced from the Rhino model>)
mesh = Mesh(<mesh referenced from the Rhino model>)
flow = Flow(
    Boundary=crv,
    Mesh=mesh,
    Grid=Slider(20000, range=0..100000),
    Steps=Slider(200, range=0..1000),
    Length=Slider(8000, range=0..50000))
crv_2 = Curve(flow)
